# Grasshopper definition test.gh (Grasshopper 0.9.76)
# plug-ins: ForceDiagram

xz = XZPlane(Origin=Point(0, 0, 0))
srf = Surface([<surface referenced from the Rhino model> x8])
crv = Curve([<curve referenced from the Rhino model> x8])
srf_2 = Surface([<surface referenced from the Rhino model> x8])
pt = Point([Point(-10, 0, 0), Point(0, 10, 0), Point(10, 0, 0), Point(0, -10, 0)])
mirror = Mirror(Geometry=srf_2, Plane=xz)  # -> Geometry, Transform
forcediagram = ForceDiagram(ListSurface1=srf, ListSurface2=srf_2, FixedBoundary=crv, FixedPoints=pt)
